% Simulink data dictionary intelligent_inspection_interfaces.sldd

InspectionData = Simulink.Bus()
  itemId: uint32, Min=0, Max=4294967295, Unit="1"  % RangeOrEncoding=Identifier; ValidityAndDefault=Valid when nonzero; default `0`
  payloadRef: uint32, Min=0, Max=4294967295, Unit="1"  % RangeOrEncoding=Identifier; ValidityAndDefault=Must resolve when nonzero; default `0`
  modality: uint8, Min=0, Max=255, Unit="1"  % RangeOrEncoding=Modality encoding; ValidityAndDefault=Valid values `1–5`; default `0`
  sourceId: uint32, Min=0, Max=4294967295, Unit="1"  % RangeOrEncoding=Identifier; ValidityAndDefault=Valid when nonzero; default `0`
  sequenceId: uint32, Min=0, Max=4294967295, Unit="1"  % RangeOrEncoding=`[0,4294967295]`; ValidityAndDefault=`0` is unassigned; default `0`
  timestamp: uint64, Min=0, Max=1.844674e+19, Unit="ms"  % RangeOrEncoding=Unix epoch UTC; ValidityAndDefault=Valid when nonzero; default `0`
  schemaVersion: uint16, Min=0, Max=65535, Unit="1"  % RangeOrEncoding=Version identifier; ValidityAndDefault=Valid when nonzero; default `0`

InspectionMetadata = Simulink.Bus()
  itemId: uint32, Min=0, Max=4294967295, Unit="1"  % RangeOrEncoding=Identifier; ValidityAndDefault=Must match `InspectionData.itemId`; default `0`
  acquisitionContext: uint32, Min=0, Max=4294967295, Unit="1"  % RangeOrEncoding=Configuration/evidence reference; ValidityAndDefault=Must resolve when nonzero; default `0`
  calibrationRef: uint32, Min=0, Max=4294967295, Unit="1"  % RangeOrEncoding=Reference; ValidityAndDefault=`0` explicitly means unavailable; default `0`
  contextSchemaVersion: uint16, Min=0, Max=65535, Unit="1"  % RangeOrEncoding=Version identifier; ValidityAndDefault=Valid when nonzero; default `0`

DataQualityResult = Simulink.Bus()
  itemId: uint32, Min=0, Max=4294967295, Unit="1"  % RangeOrEncoding=Identifier; ValidityAndDefault=Must reference the assessed item; default `0`
  status: uint8, Min=0, Max=255, Unit="1"  % RangeOrEncoding=Data-quality encoding; ValidityAndDefault=Valid values `1–3`; default `0`
  measures: single[32 1], Min=0, Max=1, Unit="1"  % RangeOrEncoding=Each entry `[0,1]`; ValidityAndDefault=First `measureCount` entries valid; unused entries `0`
  thresholdRefs: uint32[32 1], Min=0, Max=4294967295, Unit="1"  % RangeOrEncoding=Reference identifiers; ValidityAndDefault=Aligned with `measures`; unused entries `0`
  reasonCodes: uint8[16 1], Min=0, Max=255, Unit="1"  % RangeOrEncoding=Configured code encoding; ValidityAndDefault=First `reasonCodeCount` entries valid; unused entries `0`
  validatorVersion: uint16, Min=0, Max=65535, Unit="1"  % RangeOrEncoding=Version identifier; ValidityAndDefault=Valid when nonzero; default `0`
  measureCount: uint8, Min=0, Max=32, Unit="1"  % RangeOrEncoding=`[0,32]`; ValidityAndDefault=Default `0`
  reasonCodeCount: uint8, Min=0, Max=16, Unit="1"  % RangeOrEncoding=`[0,16]`; ValidityAndDefault=Default `0`

ProcessedData = Simulink.Bus()
  processedItemId: uint32, Min=0, Max=4294967295, Unit="1"  % RangeOrEncoding=Identifier; ValidityAndDefault=Valid when nonzero; default `0`
  sourceItemId: uint32, Min=0, Max=4294967295, Unit="1"  % RangeOrEncoding=Identifier; ValidityAndDefault=Must resolve to the source item; default `0`
  representationRef: uint32, Min=0, Max=4294967295, Unit="1"  % RangeOrEncoding=Reference; ValidityAndDefault=Must resolve when nonzero; default `0`
  transformRecordRef: uint32, Min=0, Max=4294967295, Unit="1"  % RangeOrEncoding=Evidence reference; ValidityAndDefault=Must resolve when nonzero; default `0`
  configurationVersion: uint16, Min=0, Max=65535, Unit="1"  % RangeOrEncoding=Version identifier; ValidityAndDefault=Valid when nonzero; default `0`
  schemaVersion: uint16, Min=0, Max=65535, Unit="1"  % RangeOrEncoding=Version identifier; ValidityAndDefault=Valid when nonzero; default `0`

DetectionResult = Simulink.Bus()
  resultId: uint32, Min=0, Max=4294967295, Unit="1"  % RangeOrEncoding=Identifier; ValidityAndDefault=Valid when nonzero; default `0`
  processedItemId: uint32, Min=0, Max=4294967295, Unit="1"  % RangeOrEncoding=Identifier; ValidityAndDefault=Must resolve to processed data; default `0`
  labelId: uint8, Min=0, Max=255, Unit="1"  % RangeOrEncoding=Configured category code; ValidityAndDefault=`0=UNASSIGNED`, `255=INVALID`; default `0`
  confidence: single, Min=0, Max=1, Unit="1"  % RangeOrEncoding=`[0,1]`; ValidityAndDefault=Validity declared by `confidenceValid`; default `0`
  location: double[3 1], Min=-1.797693e+308, Max=1.797693e+308, Unit="m"  % RangeOrEncoding=Each entry `[-realmax('double'),realmax('double')]`; ValidityAndDefault=Validity declared by `locationValid`; invalid value `[0;0;0]`
  modelVersion: uint16, Min=0, Max=65535, Unit="1"  % RangeOrEncoding=Version identifier; ValidityAndDefault=`0` means no model version; default `0`
  schemaVersion: uint16, Min=0, Max=65535, Unit="1"  % RangeOrEncoding=Version identifier; ValidityAndDefault=Valid when nonzero; default `0`
  confidenceValid: boolean, Min=0, Max=1, Unit="1"  % RangeOrEncoding=Boolean; ValidityAndDefault=Default `false`; false requires `confidence=0`
  locationValid: boolean, Min=0, Max=1, Unit="1"  % RangeOrEncoding=Boolean; ValidityAndDefault=Default `false`; false requires zero location
  frameId: uint16, Min=0, Max=65535, Unit="1"  % RangeOrEncoding=Project-frame identifier; ValidityAndDefault=Nonzero when location is valid; default `0`

NumericalFeatureSet = Simulink.Bus()
  featureSetId: uint32, Min=0, Max=4294967295, Unit="1"  % RangeOrEncoding=Identifier; ValidityAndDefault=Valid when nonzero; default `0`
  sourceRefs: uint32[16 1], Min=0, Max=4294967295, Unit="1"  % RangeOrEncoding=Reference vector; ValidityAndDefault=First `referenceCount` entries valid; unused entries `0`
  unitDeclarations: uint16[32 1], Min=0, Max=65535, Unit="1"  % RangeOrEncoding=Configured unit-code identifiers; ValidityAndDefault=Aligned with active features; unused entries `0`
  validity: boolean[32 1], Min=0, Max=1, Unit="1"  % RangeOrEncoding=Boolean vector; ValidityAndDefault=Aligned with active features; unused entries `false`
  extractorVersion: uint16, Min=0, Max=65535, Unit="1"  % RangeOrEncoding=Version identifier; ValidityAndDefault=Valid when nonzero; default `0`
  schemaVersion: uint16, Min=0, Max=65535, Unit="1"  % RangeOrEncoding=Version identifier; ValidityAndDefault=Valid when nonzero; default `0`
  featureIds: uint16[32 1], Min=0, Max=65535, Unit="1"  % RangeOrEncoding=Numeric feature identifiers; ValidityAndDefault=First `featureCount` entries active; unused entries `0`
  featureValues: single[32 1], Min=-3.402823e+38, Max=3.402823e+38, Unit="1"  % RangeOrEncoding=Each entry `[-realmax('single'),realmax('single')]`; ValidityAndDefault=First `featureCount` entries active; unused entries `0`
  featureCount: uint8, Min=0, Max=32, Unit="1"  % RangeOrEncoding=`[0,32]`; ValidityAndDefault=Default `0`
  referenceCount: uint8, Min=0, Max=16, Unit="1"  % RangeOrEncoding=`[0,16]`; ValidityAndDefault=Default `0`

HealthPrediction = Simulink.Bus()
  predictionId: uint32, Min=0, Max=4294967295, Unit="1"  % RangeOrEncoding=Identifier; ValidityAndDefault=Valid when nonzero; default `0`
  featureSetId: uint32, Min=0, Max=4294967295, Unit="1"  % RangeOrEncoding=Identifier; ValidityAndDefault=Must resolve to a feature set; default `0`
  estimate: single, Min=-3.402823e+38, Max=3.402823e+38, Unit="1"  % RangeOrEncoding=`[-realmax('single'),realmax('single')]`; ValidityAndDefault=Validity declared by `estimateValid`; default `0`
  contextOrHorizon: uint32, Min=0, Max=4294967295, Unit="1"  % RangeOrEncoding=Reference to configured context/horizon definition; ValidityAndDefault=Validity declared by `contextOrHorizonValid`; default `0`
  uncertainty: single, Min=0, Max=1, Unit="1"  % RangeOrEncoding=`[0,1]`; ValidityAndDefault=Validity declared by `uncertaintyValid`; default `0`
  confidenceStatus: uint8, Min=0, Max=255, Unit="1"  % RangeOrEncoding=Confidence-status encoding; ValidityAndDefault=Default `0`
  modelVersion: uint16, Min=0, Max=65535, Unit="1"  % RangeOrEncoding=Version identifier; ValidityAndDefault=Valid when nonzero; default `0`
  schemaVersion: uint16, Min=0, Max=65535, Unit="1"  % RangeOrEncoding=Version identifier; ValidityAndDefault=Valid when nonzero; default `0`
  estimateValid: boolean, Min=0, Max=1, Unit="1"  % RangeOrEncoding=Boolean; ValidityAndDefault=Default `false`; false requires `estimate=0`
  contextOrHorizonValid: boolean, Min=0, Max=1, Unit="1"  % RangeOrEncoding=Boolean; ValidityAndDefault=Default `false`; false requires zero reference
  uncertaintyValid: boolean, Min=0, Max=1, Unit="1"  % RangeOrEncoding=Boolean; ValidityAndDefault=Default `false`; false requires `uncertainty=0`

RiskAssessment = Simulink.Bus()
  assessmentId: uint32, Min=0, Max=4294967295, Unit="1"  % RangeOrEncoding=Identifier; ValidityAndDefault=Valid when nonzero; default `0`
  evidenceRefs: uint32[16 1], Min=0, Max=4294967295, Unit="1"  % RangeOrEncoding=Reference vector; ValidityAndDefault=First `referenceCount` entries valid; unused entries `0`
  riskLevel: uint8, Min=0, Max=255, Unit="1"  % RangeOrEncoding=Configured category code; ValidityAndDefault=`0=UNASSIGNED`, `255=INVALID`; default `0`
  riskScore: single, Min=0, Max=1, Unit="1"  % RangeOrEncoding=`[0,1]`; ValidityAndDefault=Validity declared by `riskScoreValid`; default `0`
  confidenceStatus: uint8, Min=0, Max=255, Unit="1"  % RangeOrEncoding=Confidence-status encoding; ValidityAndDefault=Default `0`
  rationaleCodes: uint8[16 1], Min=0, Max=255, Unit="1"  % RangeOrEncoding=Configured code encoding; ValidityAndDefault=First `rationaleCount` entries valid; unused entries `0`
  policyVersion: uint16, Min=0, Max=65535, Unit="1"  % RangeOrEncoding=Version identifier; ValidityAndDefault=Valid when nonzero; default `0`
  referenceCount: uint8, Min=0, Max=16, Unit="1"  % RangeOrEncoding=`[0,16]`; ValidityAndDefault=Default `0`
  riskScoreValid: boolean, Min=0, Max=1, Unit="1"  % RangeOrEncoding=Boolean; ValidityAndDefault=Default `false`; false requires `riskScore=0`
  rationaleCount: uint8, Min=0, Max=16, Unit="1"  % RangeOrEncoding=`[0,16]`; ValidityAndDefault=Default `0`

ApprovalRequest = Simulink.Bus()
  requestId: uint32, Min=0, Max=4294967295, Unit="1"  % RangeOrEncoding=Identifier; ValidityAndDefault=Valid when nonzero; default `0`
  assessmentId: uint32, Min=0, Max=4294967295, Unit="1"  % RangeOrEncoding=Identifier; ValidityAndDefault=Must resolve to risk assessment; default `0`
  proposedRecommendation: uint32, Min=0, Max=4294967295, Unit="1"  % RangeOrEncoding=Proposed-record reference; ValidityAndDefault=Must resolve when nonzero; default `0`
  evidenceRefs: uint32[16 1], Min=0, Max=4294967295, Unit="1"  % RangeOrEncoding=Reference vector; ValidityAndDefault=First `referenceCount` entries valid; unused entries `0`
  requestedAt: uint64, Min=0, Max=1.844674e+19, Unit="ms"  % RangeOrEncoding=Unix epoch UTC; ValidityAndDefault=Valid when nonzero; default `0`
  expiresAt: uint64, Min=0, Max=1.844674e+19, Unit="ms"  % RangeOrEncoding=Unix epoch UTC; ValidityAndDefault=Must exceed `requestedAt`; default `0`
  policyVersion: uint16, Min=0, Max=65535, Unit="1"  % RangeOrEncoding=Version identifier; ValidityAndDefault=Valid when nonzero; default `0`
  referenceCount: uint8, Min=0, Max=16, Unit="1"  % RangeOrEncoding=`[0,16]`; ValidityAndDefault=Default `0`

ApprovalDecision = Simulink.Bus()
  requestId: uint32, Min=0, Max=4294967295, Unit="1"  % RangeOrEncoding=Identifier; ValidityAndDefault=Must match a request; default `0`
  decision: uint8, Min=0, Max=255, Unit="1"  % RangeOrEncoding=Approval-decision encoding; ValidityAndDefault=Valid values `1–4`; default `0`
  decidedBy: uint32, Min=0, Max=4294967295, Unit="1"  % RangeOrEncoding=Actor identifier; ValidityAndDefault=Required except system expiry; default `0`
  decidedAt: uint64, Min=0, Max=1.844674e+19, Unit="ms"  % RangeOrEncoding=Unix epoch UTC; ValidityAndDefault=Valid when nonzero; default `0`
  comments: uint32, Min=0, Max=4294967295, Unit="1"  % RangeOrEncoding=Evidence-document reference; ValidityAndDefault=`0` explicitly means no comment; default `0`
  decisionVersion: uint16, Min=0, Max=65535, Unit="1"  % RangeOrEncoding=Version identifier; ValidityAndDefault=Valid when nonzero; default `0`

RecommendedAction = Simulink.Bus()
  recommendationId: uint32, Min=0, Max=4294967295, Unit="1"  % RangeOrEncoding=Identifier; ValidityAndDefault=Valid when nonzero; default `0`
  actionCode: uint8, Min=0, Max=255, Unit="1"  % RangeOrEncoding=Configured category code; ValidityAndDefault=`0=UNASSIGNED`, `255=INVALID`; default `0`
  parameters: single[16 1], Min=-3.402823e+38, Max=3.402823e+38, Unit="1"  % RangeOrEncoding=Each entry `[-realmax('single'),realmax('single')]`; ValidityAndDefault=First `parameterCount` entries active; unused entries `0`
  evidenceRefs: uint32[16 1], Min=0, Max=4294967295, Unit="1"  % RangeOrEncoding=Reference vector; ValidityAndDefault=First `referenceCount` entries valid; unused entries `0`
  confidenceStatus: uint8, Min=0, Max=255, Unit="1"  % RangeOrEncoding=Confidence-status encoding; ValidityAndDefault=Default `0`
  approvalStatus: uint8, Min=0, Max=255, Unit="1"  % RangeOrEncoding=Approval-status encoding; ValidityAndDefault=Default `0`
  validFrom: uint64, Min=0, Max=1.844674e+19, Unit="ms"  % RangeOrEncoding=Unix epoch UTC; ValidityAndDefault=Valid when nonzero; default `0`
  validUntil: uint64, Min=0, Max=1.844674e+19, Unit="ms"  % RangeOrEncoding=Unix epoch UTC; ValidityAndDefault=Must exceed `validFrom`; default `0`
  configurationVersion: uint16, Min=0, Max=65535, Unit="1"  % RangeOrEncoding=Version identifier; ValidityAndDefault=Valid when nonzero; default `0`
  parameterCount: uint8, Min=0, Max=16, Unit="1"  % RangeOrEncoding=`[0,16]`; ValidityAndDefault=Default `0`
  referenceCount: uint8, Min=0, Max=16, Unit="1"  % RangeOrEncoding=`[0,16]`; ValidityAndDefault=Default `0`

EvidenceRecord = Simulink.Bus()
  recordId: uint32, Min=0, Max=4294967295, Unit="1"  % RangeOrEncoding=Identifier; ValidityAndDefault=Valid when nonzero; default `0`
  eventType: uint8, Min=0, Max=255, Unit="1"  % RangeOrEncoding=Event-type encoding; ValidityAndDefault=Valid values `1–10`; default `0`
  artifactRefs: uint32[16 1], Min=0, Max=4294967295, Unit="1"  % RangeOrEncoding=Reference vector; ValidityAndDefault=First `artifactReferenceCount` entries valid; unused entries `0`
  dataVersions: uint16[16 1], Min=0, Max=65535, Unit="1"  % RangeOrEncoding=Version identifiers; ValidityAndDefault=First `dataVersionCount` entries valid; unused entries `0`
  modelVersions: uint16[16 1], Min=0, Max=65535, Unit="1"  % RangeOrEncoding=Version identifiers; ValidityAndDefault=First `modelVersionCount` entries valid; unused entries `0`
  configurationVersions: uint16[16 1], Min=0, Max=65535, Unit="1"  % RangeOrEncoding=Version identifiers; ValidityAndDefault=First `configurationVersionCount` entries valid; unused entries `0`
  actorOrComponent: uint32, Min=0, Max=4294967295, Unit="1"  % RangeOrEncoding=Actor/component identifier; ValidityAndDefault=Valid when nonzero; default `0`
  timestamp: uint64, Min=0, Max=1.844674e+19, Unit="ms"  % RangeOrEncoding=Unix epoch UTC; ValidityAndDefault=Valid when nonzero; default `0`
  outcome: uint8, Min=0, Max=255, Unit="1"  % RangeOrEncoding=Outcome encoding; ValidityAndDefault=Valid values `1–6`; default `0`
  integrityMetadata: uint32, Min=0, Max=4294967295, Unit="1"  % RangeOrEncoding=Integrity-record reference; ValidityAndDefault=`0` means unavailable; default `0`
  artifactReferenceCount: uint8, Min=0, Max=16, Unit="1"  % RangeOrEncoding=`[0,16]`; ValidityAndDefault=Default `0`
  dataVersionCount: uint8, Min=0, Max=16, Unit="1"  % RangeOrEncoding=`[0,16]`; ValidityAndDefault=Default `0`
  modelVersionCount: uint8, Min=0, Max=16, Unit="1"  % RangeOrEncoding=`[0,16]`; ValidityAndDefault=Default `0`
  configurationVersionCount: uint8, Min=0, Max=16, Unit="1"  % RangeOrEncoding=`[0,16]`; ValidityAndDefault=Default `0`