% Simulink data dictionary uav_mission_supervisor.sldd

Battery_Threshold_Low = Simulink.Parameter(25, DataType="double", Min=0, Max=100, Unit="percent")  % Low-battery percentage threshold that triggers ReturnToHome.
Battery_Threshold_Critical = Simulink.Parameter(10, DataType="double", Min=0, Max=100, Unit="percent")  % Critical-battery percentage threshold that triggers SafeLanding.

MissionMode = enum(DefaultValue="NormalInspection", StorageType="int32")  % Authoritative UAV mission supervisor operating mode type.
  NormalInspection = 1  % Normal inspection operating mode.
  ReturnToHome = 2  % Committed return-to-home safety response.
  SafeLanding = 3  % Terminal safe-landing mode.
  MissionComplete = 4  % Terminal mission-complete mode.