test file "uav_mission_supervisor_tests"

suite "UAV Mission Supervisor Requirements Tests"

  case "UAV-MSN-TST-001" [simulation]
    description: Verify nominal NormalInspection behavior.
    model uav_mission_supervisor, harness uav_mission_supervisor_harness, mode Normal, start time 0, stop time 1
    input "UAV-MSN-TST-001_nominal.mat", mapped to batteryPercent, routeComplete (active)
    custom criteria:
      actual=test.sltest_simout.get('yout').getElement(1).Values.Data; expected=[MissionMode.NormalInspection;MissionMode.NormalInspection]; test.verifyClass(actual,'MissionMode'); test.verifyEqual(actual(:),expected(:));

  case "UAV-MSN-TST-002" [simulation]
    description: Verify exact low-battery threshold.
    model uav_mission_supervisor, harness uav_mission_supervisor_harness, mode Normal, start time 0, stop time 1
    input "UAV-MSN-TST-002_exact_25_percent.mat", mapped to batteryPercent, routeComplete (active)
    custom criteria:
      actual=test.sltest_simout.get('yout').getElement(1).Values.Data; expected=[MissionMode.ReturnToHome;MissionMode.ReturnToHome]; test.verifyClass(actual,'MissionMode'); test.verifyEqual(actual(:),expected(:));

  case "UAV-MSN-TST-003" [simulation]
    description: Verify battery strictly between critical and low thresholds.
    model uav_mission_supervisor, harness uav_mission_supervisor_harness, mode Normal, start time 0, stop time 1
    input "UAV-MSN-TST-003_between_thresholds.mat", mapped to batteryPercent, routeComplete (active)
    custom criteria: same code as in custom criteria of case "UAV-MSN-TST-002"

  case "UAV-MSN-TST-004" [simulation]
    description: Verify exact critical-battery threshold.
    model uav_mission_supervisor, harness uav_mission_supervisor_harness, mode Normal, start time 0, stop time 1
    input "UAV-MSN-TST-004_exact_10_percent.mat", mapped to batteryPercent, routeComplete (active)
    custom criteria:
      actual=test.sltest_simout.get('yout').getElement(1).Values.Data; expected=[MissionMode.SafeLanding;MissionMode.SafeLanding]; test.verifyClass(actual,'MissionMode'); test.verifyEqual(actual(:),expected(:));

  case "UAV-MSN-TST-005" [simulation]
    description: Verify battery below the critical threshold.
    model uav_mission_supervisor, harness uav_mission_supervisor_harness, mode Normal, start time 0, stop time 1
    input "UAV-MSN-TST-005_below_critical.mat", mapped to batteryPercent, routeComplete (active)
    custom criteria: same code as in custom criteria of case "UAV-MSN-TST-004"

  case "UAV-MSN-TST-006" [simulation]
    description: Verify low battery overrides route completion.
    model uav_mission_supervisor, harness uav_mission_supervisor_harness, mode Normal, start time 0, stop time 1
    input "UAV-MSN-TST-006_low_and_route_complete.mat", mapped to batteryPercent, routeComplete (active)
    custom criteria: same code as in custom criteria of case "UAV-MSN-TST-002"

  case "UAV-MSN-TST-007" [simulation]
    description: Verify critical battery overrides route completion.
    model uav_mission_supervisor, harness uav_mission_supervisor_harness, mode Normal, start time 0, stop time 1
    input "UAV-MSN-TST-007_critical_and_route_complete.mat", mapped to batteryPercent, routeComplete (active)
    custom criteria: same code as in custom criteria of case "UAV-MSN-TST-004"

  case "UAV-MSN-TST-008" [simulation]
    description: Verify healthy-battery mission completion.
    model uav_mission_supervisor, harness uav_mission_supervisor_harness, mode Normal, start time 0, stop time 1
    input "UAV-MSN-TST-008_healthy_route_complete.mat", mapped to batteryPercent, routeComplete (active)
    custom criteria:
      actual=test.sltest_simout.get('yout').getElement(1).Values.Data; expected=[MissionMode.MissionComplete;MissionMode.MissionComplete]; test.verifyClass(actual,'MissionMode'); test.verifyEqual(actual(:),expected(:));

  case "UAV-MSN-TST-009" [simulation]
    description: Verify below-range battery fail-safe for both routeComplete values.
    model uav_mission_supervisor, harness uav_mission_supervisor_harness, mode Normal, start time 0, stop time 1
    input "UAV-MSN-TST-009_route_false.mat", mapped to batteryPercent, routeComplete
    input "UAV-MSN-TST-009_route_true.mat", mapped to batteryPercent, routeComplete (active)
    custom criteria: same code as in custom criteria of case "UAV-MSN-TST-004"
    iterations:
      route_false: ExternalInput "UAV-MSN-TST-009_route_false.mat"
      route_true: ExternalInput "UAV-MSN-TST-009_route_true.mat"

  case "UAV-MSN-TST-010" [simulation]
    description: Verify above-range battery fail-safe.
    model uav_mission_supervisor, harness uav_mission_supervisor_harness, mode Normal, start time 0, stop time 1
    input "UAV-MSN-TST-010_above_range.mat", mapped to batteryPercent, routeComplete (active)
    custom criteria: same code as in custom criteria of case "UAV-MSN-TST-004"

  case "UAV-MSN-TST-011" [simulation]
    description: Verify non-finite battery fail-safe for NaN, positive infinity, and negative infinity.
    model uav_mission_supervisor, harness uav_mission_supervisor_harness, mode Normal, start time 0, stop time 1
    input "UAV-MSN-TST-011_nan.mat", mapped to batteryPercent, routeComplete
    input "UAV-MSN-TST-011_positive_inf.mat", mapped to batteryPercent, routeComplete
    input "UAV-MSN-TST-011_negative_inf.mat", mapped to batteryPercent, routeComplete (active)
    custom criteria: same code as in custom criteria of case "UAV-MSN-TST-004"
    iterations:
      nan: ExternalInput "UAV-MSN-TST-011_nan.mat"
      positive_inf: ExternalInput "UAV-MSN-TST-011_positive_inf.mat"
      negative_inf: ExternalInput "UAV-MSN-TST-011_negative_inf.mat"

  case "UAV-MSN-TST-012" [simulation]
    description: Verify committed ReturnToHome behavior and escalation to SafeLanding.
    model uav_mission_supervisor, harness uav_mission_supervisor_harness, mode Normal, start time 0, stop time 2
    input "UAV-MSN-TST-012_committed_rth_escalation.mat", mapped to batteryPercent, routeComplete (active)
    custom criteria:
      actual=test.sltest_simout.get('yout').getElement(1).Values.Data; expected=[MissionMode.ReturnToHome;MissionMode.ReturnToHome;MissionMode.SafeLanding]; test.verifyClass(actual,'MissionMode'); test.verifyEqual(actual(:),expected(:));

  case "UAV-MSN-TST-013" [simulation]
    description: Verify SafeLanding terminal behavior under representative subsequent inputs.
    model uav_mission_supervisor, harness uav_mission_supervisor_harness, mode Normal, start time 0, stop time 5
    input "UAV-MSN-TST-013_safe_landing_terminal.mat", mapped to batteryPercent, routeComplete (active)
    custom criteria:
      actual=test.sltest_simout.get('yout').getElement(1).Values.Data; expected=[MissionMode.SafeLanding;MissionMode.SafeLanding;MissionMode.SafeLanding;MissionMode.SafeLanding;MissionMode.SafeLanding;MissionMode.SafeLanding]; test.verifyClass(actual,'MissionMode'); test.verifyEqual(actual(:),expected(:));

  case "UAV-MSN-TST-014" [simulation]
    description: Verify MissionComplete terminal behavior under representative subsequent inputs.
    model uav_mission_supervisor, harness uav_mission_supervisor_harness, mode Normal, start time 0, stop time 4
    input "UAV-MSN-TST-014_mission_complete_terminal.mat", mapped to batteryPercent, routeComplete (active)
    custom criteria:
      actual=test.sltest_simout.get('yout').getElement(1).Values.Data; expected=[MissionMode.MissionComplete;MissionMode.MissionComplete;MissionMode.MissionComplete;MissionMode.MissionComplete;MissionMode.MissionComplete]; test.verifyClass(actual,'MissionMode'); test.verifyEqual(actual(:),expected(:));

  case "UAV-MSN-TST-015" [simulation]
    description: Verify deterministic repeated behavior, held-input stability, and typed MissionMode output.
    model uav_mission_supervisor, harness uav_mission_supervisor_harness, mode Normal, start time 0, stop time 5
    input "UAV-MSN-TST-015_repeat_run_1.mat", mapped to batteryPercent, routeComplete
    input "UAV-MSN-TST-015_repeat_run_2.mat", mapped to batteryPercent, routeComplete (active)
    custom criteria:
      actual=test.sltest_simout.get('yout').getElement(1).Values.Data; expected=[MissionMode.NormalInspection;MissionMode.NormalInspection;MissionMode.ReturnToHome;MissionMode.ReturnToHome;MissionMode.SafeLanding;MissionMode.SafeLanding]; test.verifyClass(actual,'MissionMode'); test.verifyEqual(actual(:),expected(:));
    iterations:
      repeat_run_1: ExternalInput "UAV-MSN-TST-015_repeat_run_1.mat"
      repeat_run_2: ExternalInput "UAV-MSN-TST-015_repeat_run_2.mat"

  case "UAV-MSN-TST-016" [simulation]
    description: Verify critical-battery escalation after the supervisor has already entered NormalInspection.
    model uav_mission_supervisor, harness uav_mission_supervisor_harness, mode Normal, start time 0, stop time 1
    input "UAV-MSN-TST-016_normal_then_critical.mat", mapped to batteryPercent, routeComplete (active)
    custom criteria:
      actual=test.sltest_simout.get('yout').getElement(1).Values.Data; expected=[MissionMode.NormalInspection;MissionMode.SafeLanding]; test.verifyClass(actual,'MissionMode'); test.verifyEqual(actual(:),expected(:));

  case "UAV-MSN-TST-017" [simulation]
    description: Verify route completion after NormalInspection has already been established.
    model uav_mission_supervisor, harness uav_mission_supervisor_harness, mode Normal, start time 0, stop time 1
    input "UAV-MSN-TST-017_normal_then_route_complete.mat", mapped to batteryPercent, routeComplete (active)
    custom criteria:
      actual=test.sltest_simout.get('yout').getElement(1).Values.Data; expected=[MissionMode.NormalInspection;MissionMode.MissionComplete]; test.verifyClass(actual,'MissionMode'); test.verifyEqual(actual(:),expected(:));

  case "UAV-MSN-TST-018" [simulation]
    description: Verify invalid-battery fail-safe from NormalInspection after initialization.
    model uav_mission_supervisor, harness uav_mission_supervisor_harness, mode Normal, start time 0, stop time 1
    input "UAV-MSN-TST-018_below_zero.mat", mapped to batteryPercent, routeComplete
    input "UAV-MSN-TST-018_above_100.mat", mapped to batteryPercent, routeComplete
    input "UAV-MSN-TST-018_nan.mat", mapped to batteryPercent, routeComplete
    input "UAV-MSN-TST-018_positive_inf.mat", mapped to batteryPercent, routeComplete
    input "UAV-MSN-TST-018_negative_inf.mat", mapped to batteryPercent, routeComplete (active)
    custom criteria: same code as in custom criteria of case "UAV-MSN-TST-016"
    iterations:
      below_zero: ExternalInput "UAV-MSN-TST-018_below_zero.mat"
      above_100: ExternalInput "UAV-MSN-TST-018_above_100.mat"
      nan: ExternalInput "UAV-MSN-TST-018_nan.mat"
      positive_inf: ExternalInput "UAV-MSN-TST-018_positive_inf.mat"
      negative_inf: ExternalInput "UAV-MSN-TST-018_negative_inf.mat"

  case "UAV-MSN-TST-019" [simulation]
    description: Verify invalid-battery escalation from committed ReturnToHome.
    model uav_mission_supervisor, harness uav_mission_supervisor_harness, mode Normal, start time 0, stop time 1
    input "UAV-MSN-TST-019_below_zero.mat", mapped to batteryPercent, routeComplete
    input "UAV-MSN-TST-019_above_100.mat", mapped to batteryPercent, routeComplete
    input "UAV-MSN-TST-019_nan.mat", mapped to batteryPercent, routeComplete
    input "UAV-MSN-TST-019_positive_inf.mat", mapped to batteryPercent, routeComplete
    input "UAV-MSN-TST-019_negative_inf.mat", mapped to batteryPercent, routeComplete (active)
    custom criteria:
      actual=test.sltest_simout.get('yout').getElement(1).Values.Data; expected=[MissionMode.ReturnToHome;MissionMode.SafeLanding]; test.verifyClass(actual,'MissionMode'); test.verifyEqual(actual(:),expected(:));
    iterations:
      below_zero: ExternalInput "UAV-MSN-TST-019_below_zero.mat"
      above_100: ExternalInput "UAV-MSN-TST-019_above_100.mat"
      nan: ExternalInput "UAV-MSN-TST-019_nan.mat"
      positive_inf: ExternalInput "UAV-MSN-TST-019_positive_inf.mat"
      negative_inf: ExternalInput "UAV-MSN-TST-019_negative_inf.mat"